# Grasshopper definition key-in-panel_3.gh (Grasshopper 1.0.8)
# A building's footprint extruded to its height, and the volume of the solid.

# ---- group: gi_site
# Massing: footprint times height.
# Width, depth and height in metres.
width = Slider(24, range=1..60)
depth = Slider(18, range=1..60)
height = Slider(9, range=1..30)

# ----
secrets_file = Panel("secrets.txt")

# ---- group: f_massing
rectangle = Rectangle(Plane=PlaneXY(0, 0, 0), XSize=width, YSize=depth, Radius=0)  # -> Rectangle, Length
boundary = BoundarySurfaces(Edges=rectangle.Rectangle)
Z = UnitZ(Factor=height)
extr = Extrude(Base=boundary, Direction=Z)
volume = Volume(Mesh=extr, Strength=1)
weather_api_key = Panel("WEATHER_API_KEY_3")
station = Panel("LFPB")

# ---- group: o_volume
volume_2 = Panel(volume)

# ----
get_key = GetKey(M=weather_api_key, F=secrets_file)

# ---- group: f_massing (continued)
concat = Concatenate(FragmentA=station, FragmentB=get_key)

# ==== cluster GetKey: One value of the corpus's secrets file (NAME=value per line), by its name: the key a panel held in clear.
M = ClusterInput()
F = ClusterInput()
file = ReadFile(File=F, PerLineParse=True)
split = TextSplit(Text=file, Separators="=")
item = ListItem(List=split, Index=0, Wrap=True)  # -> flatten(Item)
cull_i = CullIndex(List=split, Indices=0, Wrap=True)
mindex = MemberIndex(Set=item, Member=M)  # -> Index, Count
join = TextJoin(Text=cull_i, Join="=")  # -> flatten(Result)
item_2 = ListItem(List=join, Index=mindex.Index, Wrap=True)  # -> flatten(Item)
i = ClusterOutput(item_2)
