# Grasshopper definition key-in-pasted-cluster.gh (Grasshopper 1.0.8)
# A plot of a width and a depth, as a surface, and its area; the query for the weather of its station.

# ---- group: gi_site
# Plot: the area of a rectangular plot.
# Width and depth in metres.
width = Slider(24, range=1..60)
depth = Slider(18, range=1..60)
station = Panel("LFPB")

# ---- group: f_plot
rectangle = Rectangle(Plane=PlaneXY(0, 0, 0), XSize=width, YSize=depth, Radius=0)  # -> Rectangle, Length
boundary = BoundarySurfaces(Edges=rectangle.Rectangle)
area = Area(Geometry=boundary)  # -> Area, Centroid
weather_query = WeatherQuery(A=station)

# ---- group: o_area
plot_area = Panel(area.Area)

# ==== cluster WeatherQuery
A = ClusterInput()
weather_api_key = Panel("WEATHER_API_KEY_4")
secrets_file = Panel("secrets.txt")
get_key = GetKey(M=weather_api_key, F=secrets_file)
concat = Concatenate(FragmentA=A, FragmentB=get_key)
R = ClusterOutput(concat)

# ==== cluster GetKey: One value of the corpus's secrets file (NAME=value per line), by its name: the key a panel held in clear.
M = ClusterInput()
F = ClusterInput()
file = ReadFile(File=F, PerLineParse=True)
split = TextSplit(Text=file, Separators="=")
item = ListItem(List=split, Index=0, Wrap=True)  # -> flatten(Item)
cull_i = CullIndex(List=split, Indices=0, Wrap=True)
mindex = MemberIndex(Set=item, Member=M)  # -> Index, Count
join = TextJoin(Text=cull_i, Join="=")  # -> flatten(Result)
item_2 = ListItem(List=join, Index=mindex.Index, Wrap=True)  # -> flatten(Item)
i = ClusterOutput(item_2)
