# Grasshopper definition ds_silhouette clustering_example.gh (Grasshopper 1.0.7)
# plug-ins: Human, Pufferfish, HDTTreeUtils, Hops

points = Data([Point(5314.857657, 9388.033674, 5.5), Point(5314.347582, 9386.631689, 5.5), Point(5313.837508, 9385.229703, 5.5), Point(5316.269207, 9387.520119, 5.5), Point(5315.759133, 9386.118134, 5.5), Point(5315.249058, 9384.716149, 5.5)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])
dataset = Number(Tree({0}: [0.5744867469, 0.9724101321, 0, 0.6666666667, 1, 0.5, 0.5, 0, 0, 0, 0, 0, 0, 0.05263157895, 0.3, 0, 0], {1}: [0.5622636247, 0.954771086, 0, 0.6666666667, 1, 0.5, 0.5, 0, 0, 0, 0, 0, 0, 0, 0.15, 0, 0], {2}: [0.5500405024, 0.9371320399, 0, 0.6666666667, 1, 0.5, 0.5, 0, 0, 0, 0, 0, 0, 0, 0.05, 0, 0], {3}: [0.6083123073, 0.9659488586, 0, 0.6666666667, 1, 0.5, 0.5, 0, 0, 0, 0, 0, 0, 0.05263157895, 0.3, 0, 0], {4}: [0.5960891851, 0.9483098125, 0, 0.6666666667, 1, 0.5, 0.5, 0, 0, 0, 0, 0, 0, 0.02631578947, 0.05, 0, 0], {5}: [0.5838660628, 0.9306707665, 0, 0.6666666667, 1, 0.5, 0.5, 0, 0, 0, 0, 0, 0, 0, 0, 0, 0]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))

data = Data(dataset)

flip = FlipMatrix(Data=data)
bnd = Bounds(Numbers=flip)
remap = RemapNumbers(Value=flip, Source=bnd, Target=Domain(0, 1))  # -> Mapped, Clipped
flip_2 = FlipMatrix(Data=remap.Mapped)

normalize = BooleanToggle(True)
filter = StreamFilter(Gate=normalize, Stream0=data, Stream1=flip_2)
plot = BooleanToggle(False)
panel = Panel("""8
9
10
11""")
hops = Hops(
    _Enabled=Toggle(True),
    Data=filter,
    K_values=panel,
    X_index=Slider(0, range=0..7),
    Y_index=Slider(1, range=0..18),
    Max_iter=50,
    Tol=0.0001,
    Random_seed=0,
    Show=plot,
    CacheResultsInMemory=True,
    CacheSolveResults=True,
    RemoteDefinitionLocation="http://13.38.200.57:5090/kmeans",
    RemoteSolveVersion=(0, 1, 0),
    ShowInput_Enabled=True,
    ShowInput_Path=False,
    SynchronousSolve=True)  # -> Points, Cluster_label, Point_scores, G_scores, Tree_Path, Img_as_string
assign_paths = AssignPaths(Cluster_label=flatten(hops.Cluster_label), PathsToAssign=flatten(hops.Tree_Path))
assign_paths_2 = AssignPaths(Point_scores=flatten(hops.Point_scores), PathsToAssign=flatten(hops.Tree_Path))
cluster_label = Number(assign_paths)
point_scores = Number(assign_paths_2)
gobal_scores = Number(hops.G_scores)
img = Text(hops.Img_as_string)
sort = SortList(G_scores=gobal_scores, ValuesK=panel)  # -> Keys, reverse(ValuesK)
graph = QuickGraph(gobal_scores, SortOrder=0)
data_2 = Data(img)
best_k = Panel(sort.ValuesK)
item = ListItem(List=data_2, Index=0, Wrap=True)
str2img = DeserializeImageFromString(ImageString=data_2)

# ---- group: number of clusters
k = Slider(6, range=2..21)
item_2 = ListItem(List=best_k, Index=0, Wrap=True)

# ----
colorbrewer_set3_n_12 = Panel("""#8dd3c7
#ffffb3
#bebada
#fb8072
#80b1d3
#fdb462
#b3de69
#fccde5
#d9d9d9
#bc80bd
#ccebc5
#ffed6f""")
dam = DataDam(DataA=str2img, BufferDelay=10000000, BufferMode=0)

bitmap = BitmapFromFile(BitmapPath=dam)  # -> Bitmap, Width, Height; disabled
lng = ListLength(List=dam)  # disabled
series = Series(Start=0, Step=1, Count=lng)  # disabled
multiplication = Multiplication(A=bitmap.Height, B=series)  # disabled
Y = UnitY(Factor=multiplication)  # disabled
point = Point(Point(674.1278411, -172.2732318, 0))  # disabled
move = Move(Geometry=point, Motion=Y)  # -> Geometry, Transform; disabled
rectangle = Rectangle(Plane=move.Geometry, XSize=bitmap.Width, YSize=bitmap.Height, Radius=0)  # -> Rectangle, Length; disabled
import_image = ImportImage(File=dam, Rectangle=rectangle.Rectangle, XSamples=bitmap.Width, YSamples=bitmap.Height)  # disabled

int = Integer(item_2)
col = Colour(colorbrewer_set3_n_12)
range = Range(Domain=Domain(0, 1), Steps=expr("x-1", int))
twnthrucols = TweenThroughColors(
    Colors=col,
    Factor=range,
    Normalized=True,
    Equalized=False,
    Weighted=False,
    Loopback=False,
    Degree=3,
    InterpolationType=0,
    Alpha=True)
split = SplitList(List=col, Index=int)  # -> ListA, ListB
lng_2 = ListLength(List=col)
larger = LargerThan(FirstNumber=int, SecondNumber=lng_2)  # -> LargerThan, OrEqualTo
filter_2 = StreamFilter(Gate=larger.OrEqualTo, Stream0=split.ListA, Stream1=twnthrucols)

item_3 = ListItem(List=dam, Index=Slider(0, range=0..10), Wrap=False)
image_resource = ImageResource(item_3)

# ---- group: open files
dam_2 = DataDam(DataA=str2img, BufferDelay=10000000, BufferMode=0)
openfile = LBOpenFile(file_path=dam_2)  # -> report; plug-in component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

# ----
branch = TreeBranch(Tree=cluster_label, Path=item_2, MaintainPaths=True)
branch_2 = TreeBranch(Tree=point_scores, Path=item_2, MaintainPaths=True)
assign_paths_3 = AssignPaths(InputData=flatten(points), PathsToAssign=flatten(branch))
assign_paths_4 = AssignPaths(InputData=flatten(branch_2), PathsToAssign=flatten(branch))
cube = Cube(Value=assign_paths_4)
bnd_2 = Bounds(Numbers=cube)
graft = GraftTree(Tree=filter_2, IncludeEmptyLists=True, IncludeNullItems=True)  # -> simplify(Tree)
remap_2 = RemapNumbers(Value=cube, Source=bnd_2, Target="0.0001 to 0.3")  # -> Mapped, Clipped

# ---- group: heavy
dots = DotDisplay(Point=assign_paths_3, Colour=graft, Size=remap_2.Mapped)
