# Grasshopper definition ee_PV_example.gh (Grasshopper 1.0.7)
# plug-ins: LadybugGrasshopper, Hops

brep = Brep([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])
srf = Surface([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])
evalsrf = EvaluateSurface(Surface=srf, Point=Point(0.5, 0.5, 0))  # -> Point, Normal, UDirection, VDirection, Frame
Z = UnitZ(Factor=1)
dprod = DotProduct(VectorA=evalsrf.Normal, VectorB=Z, Unitize=False)
equals = Equality(FirstNumber=dprod, SecondNumber="1")  # -> Equality, Inequality
cull = CullPattern(List=srf, CullPattern=equals.Equality)
mjoin = MeshJoin(Meshes=flatten(brep))
mjoin_2 = MeshJoin(Meshes=flatten(cull))
falsestart = LBFalseStartToggle(True)
hops = Hops(
    _Enabled=falsestart,
    PeakpowerKW=1,
    Loss=14,
    OptimalInclination=Toggle(True),
    OptimalAngles=Toggle(True),
    UseHorizon=Toggle(True),
    Width=2.066,
    Height=0.998,
    Context=mjoin,
    Geometry=mjoin_2,
    EpwUrl="https://energyplus-weather.s3.amazonaws.com/europe_wmo_region_6/FRA/FRA_Paris.Orly.071490_IWEC/FRA_Paris.Orly.071490_IWEC.zip",
    CacheResultsInMemory=True,
    CacheSolveResults=True,
    RemoteDefinitionLocation="C:\Users\SP\ECHOES\compute - D\compute.rhino3d.appserver\src\files\ee_PV.gh",
    RemoteSolveVersion=(0, 1, 0),
    ShowInput_Enabled=True,
    ShowInput_Path=False,
    SynchronousSolve=False)  # -> ReadMe, E_d, Mesh_kWh_m²_y, E_m, Production_kWh_m²_y, HI_d, HI_m, Production_kWh_y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
panel = Panel(hops.Production_kWh_y)
mesh = Mesh(hops.Mesh_kWh_m²)
facen = FaceNormals(Mesh=hops.Mesh_kWh_m²_y)  # -> Centers, Normals
panel_2 = Panel(hops.Production_kWh_m²_y)
vdis = VectorDisplay(Anchor=facen.Centers, Vector=expr("-x*3", hops.OptNormals))
panel_3 = Panel(hops.ReadMe)
graph = QuickGraph(hops.E_d, SortOrder=0)
