# Grasshopper definition os_gh-template.gh (Grasshopper 1.0.7)

# ---- group: ui_
ui = Data(0)

# ---- group: gi_
gh_input = Data(0)

# ---- group: ri_
rhino_input = Data(0)

# ---- group: inputs
number_slider = Slider(163, range=0..1000)
number_slider_2 = Slider(585, range=0..1000)

# ---- group: ei_
external_input = Data(0)

# ---- group: f_
function = Data(0)

# ---- group: function
addition = Addition(A=number_slider, B=number_slider_2)

# ---- group: c_
control = Data(0)

# ---- group: output
panel = Panel(addition)

# ---- group: o_
output = Data(0)

# ---- group: v_
viz = Data(0)

# ---- group: t_
temp = Data(0)

# ---- group: d_
dead = Data(0)

# ----
ac = CSharpScript(run=1)  # -> A; inputs run: Boolean
# ---------- ac: C# ----------
    GrasshopperDocument.ObjectsAdded -= ObjectsAdded;
    GrasshopperDocument.ObjectsDeleted -= ObjectsRemoved;
    if(run)
    {

      if(firstRun){
//        using (StreamWriter f = File.AppendText(@"C:\My Documents\Desktop\UndoLog.txt"))
//        {
//          f.WriteLine("FirstRun");
//
//        }
        var groups = GrasshopperDocument.Objects.OfType<Grasshopper.Kernel.Special.GH_Group>().ToList();
        groups.ForEach(g => attachEvent(g));

        groups.ForEach(g => colorGroup(g));
        firstRun = false;
      }

      GrasshopperDocument.ObjectsAdded += ObjectsAdded;
      GrasshopperDocument.ObjectsDeleted += ObjectsRemoved;
    } else {
      var groups = GrasshopperDocument.Objects.OfType<Grasshopper.Kernel.Special.GH_Group>().ToList();
      groups.ForEach(g => detachEvent(g));
      firstRun = true;

    }
# ---------- ac: C# additional code ----------
  bool firstRun = true;
  void ObjectsAdded(object sender, GH_DocObjectEventArgs e){
//    using (StreamWriter f = File.AppendText(@"C:\My Documents\Desktop\UndoLog.txt"))
//    {
//      f.WriteLine("ObjectsAdded");
//
//    }
    var groups = e.Objects.OfType<Grasshopper.Kernel.Special.GH_Group>();
    if(groups.Count() == 0) return;

    foreach(Grasshopper.Kernel.Special.GH_Group grp in groups){
//      using (StreamWriter f = File.AppendText(@"C:\My Documents\Desktop\UndoLog.txt"))
//      {
//        f.WriteLine("Adding event to group");
//      }
      attachEvent(grp);

    }
  }

  void attachEvent(Grasshopper.Kernel.Special.GH_Group grp){
    grp.ObjectChanged += GroupAttributesChanged;
  }

  void detachEvent(Grasshopper.Kernel.Special.GH_Group grp){
    grp.ObjectChanged -= GroupAttributesChanged;
  }

  void ObjectsRemoved(object sender, GH_DocObjectEventArgs e){
//    using (StreamWriter f = File.AppendText(@"C:\My Documents\Desktop\UndoLog.txt"))
//    {
//      f.WriteLine("ObjectsRemoved");
//
//    }
    var groups = e.Objects.OfType<Grasshopper.Kernel.Special.GH_Group>();
    if(groups.Count() == 0) return;

    foreach(Grasshopper.Kernel.Special.GH_Group grp in groups){

      detachEvent(grp);
    }
  }

  void GroupAttributesChanged(object sender, EventArgs e){
//    using (StreamWriter f = File.AppendText(@"C:\My Documents\Desktop\UndoLog.txt"))
//    {
//      f.WriteLine("GroupAttributesChanging");
//
//
//    }
    colorGroup(sender as Grasshopper.Kernel.Special.GH_Group);
  }


  void colorGroup(Grasshopper.Kernel.Special.GH_Group grp){
    var groups = GrasshopperDocument.Objects.OfType<Grasshopper.Kernel.Special.GH_Group>();

    var keyGroups = groups.Where(g => g.NickName.Reverse().ToArray().FirstOrDefault() == '_');
    var otherGroups = groups.Except(keyGroups);

    if(keyGroups.Contains(grp)) return;

    var keyDictionary = keyGroups.ToDictionary(g => g.NickName, g => g.Colour);

    var splits = grp.NickName.Split('_');
     if(splits.Length == 1) return;
    var prefix = splits[0];
    prefix += '_';
    if(keyDictionary.ContainsKey(prefix)){
      grp.Colour = keyDictionary[prefix];
      grp.NickName = grp.NickName.Replace(prefix, "");

    }
  }
# ---------- end ac ----------
