# Grasshopper definition urb_massing-typologies.gh (Grasshopper 1.0.7)
# plug-ins: Hops, Human

your_key_keep_it_private = Panel("default")

concat = Concatenate(FragmentA="https://compute.echoes.paris/", FragmentB="urb_type-xy1.gh")
site_crv = Curve(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)
hops = Hops(
    _Path=concat,
    _Enabled=Toggle(True),
    Key="default",
    SiteCrv=site_crv,
    N=80,
    Seed=0,
    BaseAngle=30.4,
    Angle1=45,
    Angle2=45,
    Setback=4,
    MaxArea=4000,
    ChamferR=4,
    ChamferA=60,
    MinBatDim=6,
    MinBatArea=400,
    MaxBatArea=20000,
    MaxFormFactor=5.6,
    Depth=12,
    MinCourtDim=3,
    CacheResultsInMemory=False,
    CacheSolveResults=False,
    RemoteDefinitionLocation="https://compute.echoes.paris/urb_type-xy1.gh",
    RemoteSolveVersion=(0, 1, 0),
    ShowInput_Enabled=True,
    ShowInput_Path=True,
    SynchronousSolve=False)  # -> Readme, Bat, Ground, Green
d9d9d9 = ColourSwatch(SwatchColor=RGB(217, 217, 217))
ccebc5 = ColourSwatch(SwatchColor=RGB(204, 235, 197))
black = ColourSwatch(SwatchColor=RGB(0, 0, 0))
entwine = Entwine(Branch00=hops.Bat, Branch01=hops.Ground, Branch02=hops.Green, FlattenInputs=True)
entwine_2 = Entwine(Branch00=black, Branch01=d9d9d9, Branch02=ccebc5, FlattenInputs=True)
previewmat = CustomPreviewMaterials(Geometry=entwine, DiffuseColor=entwine_2)
