# Grasshopper definition vm_procedural-forestry_example.gh (Grasshopper 1.0.7)
# plug-ins: Human, Wombat, Hops, LadybugGrasshopper

your_key_keep_it_private = Panel("default")

# ---- group: n arbres / DB items
genes = GenePool(Decimals=0, Maximum=20, Minimum=0, Value=[20, 14, 0, 19, 13, 0])

# ----
colorbrewer_set3_n_12 = Panel("""#8dd3c7
#ffffb3
#bebada
#fb8072
#80b1d3
#fdb462
#b3de69
#fccde5
#d9d9d9
#bc80bd
#ccebc5
#ffed6f""")
concat = Concatenate(FragmentA="https://compute.echoes.paris/", FragmentB="vm_procedural-urban-forestry.gh")

# ---- group: terre
e_terre = Number([4.439872423, 1.329430009, 0.7130092511, 0.1363635063, 2.765650169, 6, 2.006023007, 3.598498185, 5.242137734])
crv = Curve([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])

# ---- group: bat
crv_2 = Curve([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])

# ---- group: Tree DB
data = Data(["Type;Species;Variety / Cultivar;French common name;Size class;Development state;Growing speed;Total height (m);Trunk diameter (cm);Crown height (m);Crown diameter (m);Shape of the crown;Leaf persistency;Flowering (months);Fructification (seasons);Albedo of the crown - summer (RGB);Reaction to cut;Drought tolerance;Resistance to urban pollution;Resistance to salt;Adaptation to dry soils;Adaptation to fresh soils;Adaptation to humid soils;Adaptation to calcareous/alcalin soils;Adaptation to acid soils;Adaptation to Ph neutral soils;Adaptation to light soils (a.g.sandy);Adaptation to heavy soils (e.g. clay);Minimal soil depht (m);Minimal ground from the trunk (m);Optimal light expositions;Water needs;Minimal distance from buildings (m);Minimal distance from other trees (m);Optimal distance from other trees (m);Distance from footpaths (m);Minimal distance  from aboveground networks (m);Distance from underground networks (m);Types of climate;Original region;Introduction in Europe (date);Quality of shadow;Stomatic resistance (s/m) - leaf;Stomatic resistance (s/m) - canopy;Evapotranspiration effect;Polluants absorption;Caractéristiques gênantes", "Acer;pseudoplatanus;;Érable sycomore;1ere taille (> 12m);Adult;Fast;14.84;90;12.82;13;ovoïde;Decidous;May;Summer;70,116,77;;;Sensible;No;Not too dry;Yes;/;Yes;No;Yes;Yes;Non;2;1.5;Sun, half-shaded;;8;8;10;1.5;3.45;2.45;;Hemisphere North;/;High;;;;;", "Celtis;australis;;Micocoulier de Provence;1ere taille (> 12m);Adult;Normal;17.35;73;14.1;16;ovoïde;Decidous;September, October;Summer;89,104,73;;;/;No;Yes;No;No;Yes;Yes;Yes;No;Yes;2;1.5;Sun;;8;8;10;1.5;3.365;2.365;;Sud Europe, mediterranean regions, Western Asia, North Africa;/;Medium;;;;;", "Platanus;occidentalis;;;1ere taille (> 12m);Adult;Fast;20;93;16.5;15;ovoïde;Decidous;May;Autumn;61,102,68;;;/;Yes;Not too dry;Yes;Yes;Yes;No, but ok if slightly acid;Yes;Yes;Yes;2;1.5;Sun;;8;8;10;1.5;3.465;2.465;;North-East America;1500;/;;;;;", "Platanus;orientalis;;Platane d'Orient;1ere taille (> 12m);Adult;Fast;43;287;36;29;ovoïde;Decidous;June;Autumn;64,104,70;;;/;Yes;No, but it can resist for short periods;Yes;Yes;Yes, best configuration;No, but ok if slightly acid;Yes;Yes;Yes;2;1.5;Sun;;8;8;10;1.5;4.435;3.435;;Sud-East Europe (Balkans);/;/;;;;;", "Sophora;japonica;;Sophora du Japon;1e grandeur;Adult;Fast;22.7;105;18.3;17.5;ovoïde;Decidous;Summer;Autumn;61,98,64;;;/;/;No;Yes ;Yes;No;Yes;Yes;Yes;Yes;2;1.5;Sun, half-shaded;;8;8;10;1.5;3.525;2.525;;South Asia;1747;Low;;;;;", "Acer ;Campestre;;ÉRABLE CHAMPÊTRE;2eme taille, entre 6 et 12;Adult;Normal;10.62;77;8.72;10;ovoïde;Decidous;May;Summer;51,136,79;;;/;Yes;Not too dry;Yes;Not too humid;No;No;Yes;Yes;Yes;1.5;1.5;Sun, half-shaded;;4;6;8;1.5;3.385;2.385;;Europe, East Asia;/;Medium;;;;;"])

# ----
panel = Panel("C:\Users\SP\AppData\Roaming\McNeel\Rhinoceros\7.0\Localization\en-US\Render Content\")

boundary = BoundarySurfaces(Edges=crv_2)
Z = UnitZ(Factor="31")
extr = Extrude(Base=boundary, Direction=Z)

concat_2 = Concatenate(FragmentA=panel, FragmentB="Wood\Pine\Maritime pine.rmtl")
falsestart = LBFalseStartToggle(True)
panel_2 = Panel("3.20.0")
bois = ColourSwatch(SwatchColor=RGB(143, 134, 117))
hops = Hops(
    _Path=concat,
    _Enabled=falsestart,
    Key=your_key_keep_it_private,
    G=crv,
    G_d=e_terre,
    B_fCrv=crv_2,
    Seed=Slider(25, range=0..110),
    Plants_DB=data,
    Plants_N=genes,
    Strategy="2.5",
    CacheResultsInMemory=False,
    CacheSolveResults=False,
    RemoteDefinitionLocation="https://compute.echoes.paris/vm_procedural-urban-forestry.gh",
    RemoteSolveVersion=(0, 1, 0),
    ShowInput_Enabled=True,
    ShowInput_Path=True,
    SynchronousSolve=True)  # -> Readme, P_zones, Seeds, Relaxed, D_buildings, Foliage, Trunk, Roots
timber_lines = Colour(bois)
timber = Data(concat_2)
col = Colour(simplify(graft(colorbrewer_set3_n_12)))
pt = Point(hops.Seeds)
previewlw = CustomPreviewLineweights(Geometry=hops.P_zones, Shader=col, Thickness="2", Absolute=False)
mesh = Mesh([hops.Foliage, hops.Trunk, hops.Roots])
previewlw_2 = CustomPreviewLineweights(Geometry=hops.Relaxed, Shader=col, Absolute=False)
ln = Line(StartPoint=pt, EndPoint=hops.Relaxed)
crv_3 = Curve(hops.D_buildings)

e_terre_2 = Number(e_terre)
Z_2 = UnitZ(Factor=expr("-x", e_terre_2))
gradient = Gradient(
    LowerLimit="0",
    UpperLimit="8",
    Parameter=e_terre_2,
    stops=[0.0102: RGB(0, 0, 0), 0.521: RGB(80, 55, 25), 1: RGB(165, 42, 42)])
extr_2 = Extrude(Base=crv, Direction=Z_2)

cap = CapHoles(Brep=extr_2)
alpha = AdjustAlpha(Color=gradient, Alpha="0.1")

preview = CustomPreview(Geometry=cap, Material=alpha)
